% Simulink data dictionary MCU_FOC_MAIN_DD.sldd

PAS_ONE_SPD_THSD_U16 = Simulink.Parameter(13200, StorageClass="ExportedGlobal", DataType="uint16", Unit="meter/hour")
PAS_TWO_SPD_THSD_U16 = Simulink.Parameter(16200, StorageClass="ExportedGlobal", DataType="uint16", Unit="meter/hour")
PAS_THREE_SPD_THSD_U16 = Simulink.Parameter(19200, StorageClass="ExportedGlobal", DataType="uint16", Unit="meter/hour")
PAS_FOUR_SPD_THSD_U16 = Simulink.Parameter(22200, StorageClass="ExportedGlobal", DataType="uint16", Unit="meter/hour")
PAS_FIVE_SPD_THSD_U16 = Simulink.Parameter(25000, StorageClass="ExportedGlobal", DataType="uint16", Unit="meter/hour")
DEFAULT_PAS_SPD_U16 = Simulink.Parameter(0, StorageClass="ExportedGlobal", DataType="uint16", Unit="meter/hour")
mid_flg_LeftBrake_Status = Simulink.Signal(StorageClass="ExportedGlobal", DataType="boolean")
mid_flg_RightBrake_Status = Simulink.Signal(StorageClass="ExportedGlobal", DataType="boolean")
em_DrvModSpdLim_u16 = Simulink.Signal(StorageClass="ExportedGlobal", DataType="uint16", Unit="meter/hour")
mid_WalkModeAct_flg = Simulink.Signal(StorageClass="ExportedGlobal", DataType="boolean")
mid_CCModeAct_flg = Simulink.Signal(StorageClass="ExportedGlobal", DataType="boolean")
tm_VehSpd_u16 = Simulink.Signal(StorageClass="ExportedGlobal", DataType="uint16", Unit="meter/hour")
mi_Throttle_mvu16 = Simulink.Signal(StorageClass="ExportedGlobal", DataType="uint16", Unit="mV")
mid_VehModes_u8 = Simulink.Signal(StorageClass="ExportedGlobal", DataType="uint8")
mid_flg_ChildModeEn = Simulink.Signal(StorageClass="ExportedGlobal", DataType="boolean")
mid_PAS_En_flg = Simulink.Signal(StorageClass="ExportedGlobal", DataType="boolean")
mid_PedalAssist_u8 = Simulink.Signal(StorageClass="ExportedGlobal", DataType="uint8")
WALKMODE_SPD_LIM_U16 = Simulink.Parameter(4500, StorageClass="ExportedGlobal", DataType="uint16", Unit="meter/hour")
THROTTLE_THRESHOLD_U16 = Simulink.Parameter(950, StorageClass="ExportedGlobal", DataType="uint16", Unit="meter/hour")
FITNESS_MODE_U8 = Simulink.Parameter(5, StorageClass="ExportedGlobal", DataType="uint8")
THROTTLE_SPD_LIM_U16 = Simulink.Parameter(25000, StorageClass="ExportedGlobal", DataType="uint16", Unit="meter/hour")
DEFAULT_SPD_LIM_U16 = Simulink.Parameter(0, StorageClass="ExportedGlobal", DataType="uint16", Unit="meter/hour")
MODEL_CONFIG_PARENT = Simulink.ConfigSet(StartTime="0", StopTime="10", FixedStep="0.001", Solver="FixedStepDiscrete", ProdHWDeviceType="Intel->x86-64 (Windows64)", SystemTargetFile="ert.tlc", TargetLang="C")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
MODEL_CONFIG_CHILD = Simulink.ConfigSet(StartTime="0", StopTime="10", FixedStep="0.001", Solver="FixedStepDiscrete", ProdHWDeviceType="Intel->x86-64 (Windows64)", SystemTargetFile="ert.tlc", TargetLang="C")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
BOOLEAN_ONE = Simulink.Parameter(1, StorageClass="ExportedGlobal", DataType="boolean")
fm_ThrottleErr_flg = Simulink.Signal(StorageClass="ExportedGlobal", DataType="boolean")
fm_UnderVLTGErr_flg = Simulink.Signal(StorageClass="ExportedGlobal", DataType="boolean")
ZERO_i32 = Simulink.Parameter(0, StorageClass="ExportedGlobal", DataType="int32")
mi_HallState_U8 = Simulink.Signal(StorageClass="ExportedGlobal", DataType="uint8")
fm_MotorBlockCutoff = Simulink.Signal(StorageClass="ExportedGlobal", DataType="boolean")
CURR_CUTOFF_CTR_U16 = Simulink.Parameter(300, StorageClass="ExportedGlobal", DataType="uint16", Unit="ms")
MILLI_SEC_COUNTS_5000_U16 = Simulink.Parameter(5000, StorageClass="ExportedGlobal", DataType="uint16", Unit="ms")
MAX_SPD_VALUE_U16 = Simulink.Parameter(25000, StorageClass="ExportedGlobal", DataType="uint16", Unit="meter/hour")
MIN_SPD_VALUE_U16 = Simulink.Parameter(0, StorageClass="ExportedGlobal", DataType="uint16", Unit="meter/hour")
CURRENTCUTOFF_LIM_mA_i32 = Simulink.Parameter(20000, StorageClass="ExportedGlobal", DataType="int32", Unit="mA")
MOTOR_BLOCK_CTR_U16 = Simulink.Parameter(2000, StorageClass="ExportedGlobal", DataType="uint16", Unit="ms")
MILLI_SEC_COUNTS_3000_U16 = Simulink.Parameter(3000, StorageClass="ExportedGlobal", DataType="uint16", Unit="ms")
BATTERY_UV_RST_LIM_U16 = Simulink.Parameter(30500, StorageClass="ExportedGlobal", DataType="uint16", Unit="mV")
BATTERY_UV_LIM_U16 = Simulink.Parameter(30300, StorageClass="ExportedGlobal", DataType="uint16", Unit="mV")
THROTT_ERR_LWRTHSD_U16 = Simulink.Parameter(800, StorageClass="ExportedGlobal", DataType="uint16", Unit="mV")
THROTT_ERR_UPRTHSD_U16 = Simulink.Parameter(5000, StorageClass="ExportedGlobal", DataType="uint16", Unit="mV")
SAMPLE_TIME_1MS = Simulink.Parameter(1, StorageClass="ExportedGlobal", DataType="uint16", Unit="ms")
THROTTLE_INITIATION_VALUE_U16 = Simulink.Parameter(950, StorageClass="ExportedGlobal", DataType="uint16", Unit="mV")
mi_BatVlt_mv_U16 = Simulink.Signal(StorageClass="ExportedGlobal", DataType="uint16", Unit="mV")
mi_Battery_Current_mA_i32 = Simulink.Signal(StorageClass="ExportedGlobal", DataType="int32", Unit="mA")
PWM_DUTYCYCLE_Hz_U16 = Simulink.Signal(StorageClass="ExportedGlobal", DataType="uint16", Unit="Hz")
fm_SAF_CurrentCutoff = Simulink.Signal(StorageClass="ExportedGlobal", DataType="boolean")
CONST_ONE_u8 = Simulink.Parameter(1, StorageClass="ExportedGlobal", DataType="uint8")
SPD_BUFFER_u16 = Simulink.Parameter(200, StorageClass="ExportedGlobal", DataType="uint16", Unit="meter/hr")
SPD_CONV_METER_u16 = Simulink.Parameter(1000, StorageClass="ExportedGlobal", DataType="uint16")
ECO_MODE_SPD_LIM_u16 = Simulink.Parameter(20200, StorageClass="ExportedGlobal", DataType="uint16", Unit="meter/hr")
URBAN_MODE_SPD_LIM_u16 = Simulink.Parameter(25200, StorageClass="ExportedGlobal", DataType="uint16", Unit="meter/hr")
DEFAULT_MAX_SPD_LIM_u16 = Simulink.Parameter(25200, StorageClass="ExportedGlobal", DataType="uint16", Unit="meter/hr")
mid_ChildModeSpd_u8 = Simulink.Signal(StorageClass="ExportedGlobal", DataType="uint8", Unit="kilometer/hr")
MILLI_SEC_COUNTS_2000_U16 = Simulink.Parameter(2000, StorageClass="ExportedGlobal", DataType="uint16")
mi_WheelDia_inch_u16 = Simulink.Signal(StorageClass="ExportedGlobal", DataType="uint16")
mi_MotorRPM_u16 = Simulink.Signal(StorageClass="ExportedGlobal", DataType="uint16")
mi_WheelRPM_u16 = Simulink.Signal(StorageClass="ExportedGlobal", DataType="uint16")
SPD_PI_KP_u16 = Simulink.Parameter(1, StorageClass="ExportedGlobal", DataType="uint16")
SPD_PI_KI_u16 = Simulink.Parameter(1, StorageClass="ExportedGlobal", DataType="uint16")
SPD_PI_INIT_VAL_u16 = Simulink.Parameter(1, StorageClass="ExportedGlobal", DataType="uint16")
MILLI_SEC_COUNTS_10000_U16 = Simulink.Parameter(10000, StorageClass="ExportedGlobal", DataType="uint16")
MILLI_SEC_COUNTS_1000_U16 = Simulink.Parameter(1000, StorageClass="ExportedGlobal", DataType="uint16")
BOOLEAN_ZERO = Simulink.Parameter(0, StorageClass="ExportedGlobal", DataType="boolean")
mi_HornButton_flg = Simulink.Signal(StorageClass="ExportedGlobal", DataType="boolean")
mi_KeyStatus_flg = Simulink.Signal(StorageClass="ExportedGlobal", DataType="boolean")
mi_PowerButton_flg = Simulink.Signal(StorageClass="ExportedGlobal", DataType="boolean")
mi_SOS_flg = Simulink.Signal(StorageClass="ExportedGlobal", DataType="boolean")
mi_FallDetection_flg = Simulink.Signal(StorageClass="ExportedGlobal", DataType="boolean")
mi_NegativeLongPress_flg = Simulink.Signal(StorageClass="ExportedGlobal", DataType="boolean")
sc_VehSpdDem_u16_ref = Simulink.Signal(StorageClass="ExportedGlobal", DataType="uint16", Unit="meter/hour")
sc_Motor_Speed_u32 = Simulink.Signal(StorageClass="ExportedGlobal", DataType="uint32")
pb_SOS_Alert_flg = Simulink.Signal(StorageClass="ExportedGlobal", DataType="boolean")
pb_KeyStatus_flg = Simulink.Signal(StorageClass="ExportedGlobal", DataType="boolean")
pb_ShutDown_flg = Simulink.Signal(StorageClass="ExportedGlobal", DataType="boolean")
pb_Power_ON_flg = Simulink.Signal(StorageClass="ExportedGlobal", DataType="boolean")
cw_WalkMode_flg = Simulink.Signal(StorageClass="ExportedGlobal", DataType="boolean")
cw_CruiseMode_flg = Simulink.Signal(StorageClass="ExportedGlobal", DataType="boolean")
MILLI_SEC_COUNTS_300_U16 = Simulink.Parameter(300, StorageClass="ExportedGlobal", DataType="uint16")
ZERO_U16 = Simulink.Parameter(0, StorageClass="ExportedGlobal", DataType="uint16")